# Requirement set ShipRequirements (R2026a)

Attributes:
- PerfVal1: Variable for Performance Requirements

## 1 [#1] Platform Support
The vessel must provide the shipboard services and resources necessary to support vessel operations.
Rationale: The operator, crew, and owner require the vessel to provide the shipboard services and
resources necessary to conduct vessel operations.

### 1.1 [#2] Electrical Power
The vessel shall provide electrical power necessary to support vessel operations.
Rationale: Electrical power is required to operate propulsion, command and surveillance systems, auxiliary systems, outfitting systems, and mission-specific systems.

#### 1.1.1 [#3] Electrical Power Generation
Generator sets shall be configured to produce the electrical power demanded by the shipboard load schedule for each defined operating condition.
Rationale: Shipboard electrical loads require an onboard source of electrical power when shore-supplied power is unavailable.

#### 1.1.2 [#4] Electrical Power Distribution
The electrical power distribution interfaces shall distribute electrical power from sources to loads as designated in the shipboard load schedule.
Rationale: Generated, stored, or shore-supplied electrical power must be transferred to the systems and equipment that require it.

##### 1.1.2.1 [#46] Stored-Energy Supply
The stored-energy supply interfaces shall supply stored electrical energy to designated loads under defined operating conditions.
Rationale: Stored electrical energy supports designated shipboard loads during defined operating conditions in which immediate power from another source is unavailable or insufficient.

##### 1.1.2.2 [#47] Shore Power
The shore power interfaces shall accept and distribute shore-supplied electrical power for use by designated shipboard loads.
Rationale: Shore-supplied electrical power allows designated vessel services to operate without relying solely on onboard electrical generation while the vessel is connected to shore facilities.

#### 1.1.3 [#5] Electrical Energy Storage
The battery bank shall store electrical energy received from the shipboard electrical distribution system.
Rationale: Electrical energy must be stored so that it is available for later use during defined operating conditions.
(Assumption: Battery Energy Storage System (BESS) is the only electrical energy storage system being used (as opposed to electrostatic supercapacitors, FESS, and HESS)

#### 1.1.4 [#8] Load Power Continuity
Uninterruptible Power Supplies, Emergency Generators, and Power Management Systems shall maintain the electrical power supplied to critical and essential loads during each defined loss-of-power condition.
Rationale: Loss of electrical power to loads can prevent the vessel from maintaining safety-critical and mission-critical functions.

#### 1.1.5 [#9] Electrical Power Quality
Local automatic voltage regulator, governor, converter, and harmonic filter devices shall be used in tandem with central power management and transformer systems to regulate voltage, frequency, and waveform in accordance with the defined parameters.
Rationale: Shipboard equipment requires electrical power within defined operating limits to function correctly and avoid damage or loss of performance.

### 1.2 [#10] Machinery Fluid Services
The vessel shall provide the fluids required to support the operation of installed machinery.
Rationale: Installed machinery requires cooling media, lubrication oil, fuel oil, compressed air, and hydraulic fluid to perform the allocated functions.

#### 1.2.1 [#11] Cooling Fluid Services
The cooling fluid service shall remove and transport thermal energy from installed machinery to maintain its required operating temperature limits.
Rationale: Installed machinery generates thermal energy during operation that must be transferred to an appropriate heat sink to maintain reliable operation and prevent thermal degradation.

##### 1.2.1.1 [#19] Freshwater Cooling
The freshwater cooling service shall circulate coolant through closed-loop circuits to absorb thermal energy from designated machinery.
Rationale: Closed-loop freshwater cooling removes thermal energy directly from machinery while minimizing corrosion, contamination, and fouling of internal cooling passages.

#### 1.2.2 [#12] Lubrication Services
The lubrication service shall establish and maintain the lubricating conditions required for the operation of installed machinery.
Rationale: Relative motion between contacting mechanical surfaces generates friction and wear that must be controlled to ensure reliable machinery operation and acceptable component life.

#### 1.2.3 [#13] Fuel Oil Services
The fuel oil service shall administer the chemical energy required for the operation of installed fuel-consuming machinery.
Rationale: Prime movers and auxiliary fuel-consuming systems rely on the combustion of fuel to convert chemical energy into the mechanical energy required for mechanical and electrical power generation.

##### 1.2.3.1 [#14] Propulsion Machinery Fuel Oil Supply
The propulsion fuel oil service shall administer fuel oil to propulsion machinery to support the generation of propulsive power for vessel mobility and maneuvering.
Rationale: Propulsion machinery converts the chemical energy stored in fuel into mechanical power to propel and maneuver the vessel throughout its operating envelope.
PerfVal1: 7

##### 1.2.3.2 [#15] Auxiliary Machinery Fuel Oil Supply
The auxiliary power fuel oil service shall administer fuel oil to auxiliary power generation systems to support power generation for auxiliary services.
Rationale: Auxiliary power generation converts the chemical energy stored in fuel into the power required to support auxiliary services.
PerfVal1: 3

#### 1.2.4 [#17] Compressed Air Supply
The compressed air service shall generate, store, regulate, and administer compressed air to supply the pneumatic power required for the operation of installed machinery.
Rationale: Compressed air stores potential energy that is converted to pneumatic power for designated shipboard functions requiring controlled fluid pressure.

#### 1.2.5 [#21] Hydraulic Fluid Services
The hydraulic fluid service shall pressurize and circulate hydraulic fluid to transmit power to installed hydraulically actuated machinery.
Rationale: Hydraulically actuated machinery requires pressurized fluid to transmit power and produce controlled mechanical motion or force.

### 1.3 [#25] Thermal Management
The thermal management service shall regulate, recover, and reject thermal energy to maintain the thermal conditions required by installed equipment and machinery spaces.
Rationale: Installed equipment and operating machinery generate thermal energy that must be managed to prevent overheating, preserve required equipment performance, and maintain acceptable machinery-space conditions; thermal energy is recovered and reused when economically feasible.

#### 1.3.1 [#26] Thermal Environment Control
The thermal-environment-control service shall regulate the thermal conditions required within designated vessel spaces.
Rationale: Equipment performance, machinery reliability, and material integrity depend upon maintaining environmental temperatures within their specified operating limits.

##### 1.3.1.1 [#27] Machinery-Space Thermal Control
The machinery-space thermal-control service shall regulate the thermal conditions required within designated machinery spaces.
Rationale: Heat released by installed machinery must be managed to maintain acceptable operating conditions within machinery spaces.

##### 1.3.1.2 [#28] Equipment-Space Thermal Control
The equipment-space thermal-control service shall regulate the thermal conditions required within designated equipment spaces.
Rationale: Temperature-sensitive electrical, electronic, command, surveillance, and mission equipment require controlled thermal environments to maintain their performance and reliability.

#### 1.3.2 [#29] Thermal Energy Recovery
The thermal-energy-recovery service shall recover usable thermal energy from designated vessel heat sources.
Rationale: Thermal energy generated during vessel operation may be recovered and redirected to shipboard uses, reducing the demand for additional energy sources.

##### 1.3.2.1 [#31] Recovered Thermal Energy Utilization
The recovered-thermal-energy-utilization service shall transfer recovered thermal energy to designated shipboard thermal loads.
Rationale: Recovered thermal energy can satisfy shipboard heating demands that would otherwise require additional fuel or electrical power.

#### 1.3.3 [#32] Environmental Heat Rejection
The environmental heat-rejection service shall discharge thermal energy that cannot be beneficially utilized to available external heat sinks.
Rationale: Thermal energy that cannot be recovered for useful purposes must ultimately be rejected to prevent heat accumulation and sustain continuous vessel operation.

##### 1.3.3.1 [#35] Seawater Heat Rejection
The seawater heat-rejection service shall transfer thermal energy from designated vessel cooling circuits to the surrounding seawater.
Rationale: The seawater surrounding the vessel provides a high-capacity external heat sink for the sustained rejection of thermal energy generated during vessel operation.

##### 1.3.3.2 [#36] Air Heat Rejection
The air heat-rejection service shall transfer thermal energy from designated vessel systems to the surrounding atmosphere where atmospheric heat rejection is required.
Rationale: Ambient air provides an external heat sink for systems designed to reject thermal energy directly to the atmosphere.

#### 1.3.4 [#38] Thermal Energy Transfer
The thermal-energy-transfer service shall transfer thermal energy between designated thermal systems while maintaining the required separation of working media.
Rationale: Thermal energy must frequently be transferred between independent thermal systems without mixing the associated working media in order to support cooling, heating, recovery, and rejection processes.

### 1.4 [#39] Shipboard Water Services
The shipboard water services shall process, store, and distribute different grades of water according to end use.
Rationale: Water aboard ship supports both machinery and personnel through multiple water qualities and distribution networks.

#### 1.4.1 [#48] Freshwater Production
Freshwater production shall treat seawater intake through reverse osmosis or distillation such that the end product is desalinated.
(Assumption: for simplification, freshwater services intakes seawater only)
Rationale: Freshwater production onboard reduces the vessel's dependence on shore-side and bunkering replenishment.

#### 1.4.2 [#51] Freshwater Storage
The freshwater storage service shall retain freshwater in designated tanks while preserving the volume and water quality required for subsequent shipboard use.
Rationale: Freshwater must be retained between production or replenishment and consumption so that shipboard demand can be met despite variations in production rate, replenishment availability, and usage.
(Assumption: freshwater is not distributed to consumption outlets immediately after production and moved to tanks first instead)

#### 1.4.3 [#52] Machinery Makeup Water
The machinery makeup water service shall replenish freshwater losses within closed-loop machinery circuits.
Rationale: Closed-loop machinery systems such as cooling circuits gradually lose water through maintenance, leakage, venting, or sampling.

#### 1.4.4 [#53] Freshwater Distribution
The freshwater distribution service shall use pumps and valves configured in designated paths to convey freshwater to and from storage tanks at flow rates and pressures in accordance with the defined parameters.
Rationale: Freshwater tanks and consumers require controlled conveyance for storage safety, point-of-use safety, and practical use.

#### 1.4.5 [#55] Potable Water Production
Potable water production shall treat freshwater intake through remineralization, pH adjustment, and disinfection such that the end product is potable.
(Assumption: for simplification, potable water services intakes freshwater only)
Rationale: Personnel require potable water for drinking, food preparation, and hygiene.

#### 1.4.6 [#56] Potable Water Storage
The potable storage service shall retain freshwater in designated tanks while preserving the volume and water quality required for subsequent shipboard use.
Rationale: Potable water must be retained between production or replenishment and consumption so that shipboard demand can be met despite variations in production rate, replenishment availability, and usage.
(Assumption: potable water is not distributed to consumption outlets immediately after production and moved to tanks first instead)

#### 1.4.7 [#57] Potable Water Distribution
The potable water distribution service shall use pumps and valves configured in designated paths to convey freshwater to and from storage tanks at flow rates and pressures in accordance with the defined parameters.
Rationale: Potable water tanks and consumers require controlled conveyance to ensure storage safety, point-of-use safety, and practical use.

### 1.5 [#61] Waste Management
The waste-management service shall control the collection, segregation, processing, retention, and disposition of waste streams generated during vessel operation.
Rationale: Vessel operation generates waste streams with differing physical and chemical properties, hazards, processing needs, and discharge restrictions that must be managed to protect personnel, equipment, the vessel, and the surrounding environment.

#### 1.5.1 [#72] Oily Waste Management
The oily-waste-management service shall collect, separate, monitor, retain, and dispose of oily mixtures and oil residues generated by machinery-space operations.
Rationale: Machinery operation generates oily bilge water and oil residues that require controlled handling to prevent marine pollution.
Basis: MARPOL Annex I (Prevention of Pollution by Oil)

#### 1.5.2 [#73] Sewage Management
The sewage-management service shall collect, treat, retain, and dispose of sewage generated aboard the vessel.
Rationale: Sewage requires controlled treatment and disposition to protect personnel health and the marine environment.
Basis: MARPOL Annex IV (Prevention of Pollution by Sewage from Ships)

#### 1.5.3 [#74] Garbage Management
The garbage-management service shall collect, segregate, process, retain, and dispose of ship-generated garbage according to its material category.
Rationale: Different garbage categories require different handling methods to support environmental compliance and efficient vessel operation.
Basis: MARPOL Annex V (Prevention of Pollution by Garbage from Ships)

### 1.6 [#75] Atmospheric Management
The atmospheric management service shall maintain the atmospheric conditions required to support personnel, installed equipment, and vessel operations.
Rationale: The vessel atmosphere must be continuously managed to maintain acceptable air quality, ventilation, contaminant control, and other atmospheric conditions necessary for safe, healthy, and reliable vessel operation.

#### 1.6.1 [#76] Ventilation
Ventilation shall circulate and exchange air within designated vessel spaces to maintain the defined air quality parameters for that space.
Rationale: Air circulation and ventilation distribute fresh air, remove contaminants, prevent stagnant air, and maintain acceptable atmospheric conditions throughout occupied and designated equipment spaces.

#### 1.6.2 [#77] Hazardous Gases Management
Hazardous gases management shall detect, isolate, and mitigate hazardous atmospheric conditions generated during vessel operation.
Rationale: Machinery operation, fuel handling, cargo operations, and onboard processes may generate hazardous atmospheres that require detection and mitigation to protect personnel, equipment, and the vessel.

#### 1.6.3 [#78] Emissions Management
Emissions Management shall control atmospheric emissions generated during vessel operation in accordance with applicable environmental regulations.
Rationale: Propulsion machinery, auxiliary machinery, incineration equipment, and other onboard processes generate atmospheric emissions that require control to reduce environmental impact and satisfy applicable emission regulations.
Basis: MARPOL Annex VI

### 1.7 [#79] Habitability and Ergonomics

#### 1.7.1 [#80] Consumables Storage

#### 1.7.2 [#81] Domestic Water Use

#### 1.7.3 [#106] Lighting

## 2 [#86] Mission Systems Support
The vessel must deploy the mission-specific systems necessary to perform mission operations.
(Assumption: disregard lifecycle considerations for simplicity)
Rationale: Mission accomplishment depends on the operability of mission systems.

### 2.1 [#87] Mission Systems Integration
Mission systems integration shall unite mission systems with the platform through interfaces and standardized physical connections.
Rationale: The operability of mission systems depends on their connectivity with the platform, such that the exchange of physical resources and information necessary for mission operations may occur.

### 2.2 [#88] Mission Systems Operation
Control systems shall execute commands issued by designated human and automated operators.
Rationale: For the equipment associated with the mission system to serve its intended purposes, operators must be able to command equipment behavior.

### 2.3 [#89] Mission Information
Cyber-physical systems shall generate and report mission information by running information processing cycles.
Rationale: Information allows an operator to be certain that the command they issue instructs appropriate control.

### 2.4 [#90] Mission Communications
Authorized entities shall exchange mission information on the basis of interface-specific network protocols.
Rationale: Mission-system operation depends upon the timely exchange of mission information between participating entities.

### 2.5 [#91] Mission Resources
Physical gradients and system requests shall route vessel resources through mission-systems-to-platform interfaces.
Rationale: Mission systems require platform resources to perform their intended operational functions.

## 3 [#95] Safety and Survivability
The vessel must protect personnel, mission systems, and the platform from hazards encountered during routine operations while maintaining the ability to withstand and recover from foreseeable emergency conditions and failures.
Rationale: Personnel safety, mission accomplishment, and preservation of the vessel depend upon preventing hazards during normal operation and maintaining essential capabilities during failures and emergency conditions.

### 3.1 [#96] Operational Hazard Control

#### 3.1.1 [#98] Hazardous Materials Management

#### 3.1.2 [#99] Guarding and Shielding

#### 3.1.3 [#100] Fail-Safe Mechanisms

### 3.2 [#101] Fire Suppression

#### 3.2.1 [#102] Fire Zoning

#### 3.2.2 [#103] Fire SCADA

#### 3.2.3 [#104] Fire Extinguishment

### 3.3 [#105] Flood Protection

#### 3.3.1 [#107] Sealed Integrity

#### 3.3.2 [#109] Equalization
(cross-flooding and counter-flooding)

#### 3.3.3 [#110] Flooding SCADA

#### 3.3.4 [#111] Dewatering

### 3.4 [#112] Critical Function Continuity

#### 3.4.1 [#113] Critical Function Independence

#### 3.4.2 [#114] Emergency Service Supply

#### 3.4.3 [#115] Degraded Operation

### 3.5 [#116] Evacuability

#### 3.5.1 [#117] Survival Craft

### 3.6 [#118] Casualty Response

#### 3.6.1 [#119] Casualty SCADA

#### 3.6.2 [#120] Essential Function Recovery

## 4 [#121] Seakeeping and Stability
The vessel must remain stable and safe throughout the range of loading conditions and environmental conditions expected during its intended operations.
Rationale: Vessel safety, operational capability, and the uncompromised transportation of cargo depend on maintaining acceptable equilibrium and motion response as weight distribution, fluid loading, mission configuration, and environmental conditions vary.

### 4.1 [#122] Loading Condition

#### 4.1.1 [#123] Design Loading Conditions
Still water moments, shear forces, and dynamic wave loading shall be evaluated for the fully loaded departure, fully loaded arrival, departure ballast, and arrival ballast conditions.
Rationale: Defined loading states provide repeatable analysis cases of vessel loading and operation.

### 4.2 [#124] Weight Distribution
Each mass loaded on to the vessel shall be assigned a location based on the effect of its weight as modeled along the vertical, longitudinal, and transverse axes of distribution in the lightship and deadweight conditions.
Rationale: The longitudinal, transverse, and vertical distribution of vessel weight determines equilibrium attitude, center-of-gravity position, and righting characteristics.

#### 4.2.1 [#126] Lightship Weight

#### 4.2.2 [#127] Variable Load

#### 4.2.3 [#128] Center of Gravity

### 4.3 [#125] Fluid Loading
The allocation of fluid to tanks shall be informed by the effects of the distributed volumes as modeled for each design loading condition.
Rationale: Tank contents affect displacement, trim, center of gravity, free-surface effects, and the vessel’s response to environmental excitation.

#### 4.3.1 [#129] Free-Surface Effect
The impact of partially filled tanks on the metacentric height of the vessel shall be determined using free-surface correction.
Rationale: Fluid movement within a partially filled tank can reduce effective stability and alter dynamic response.

### 4.4 [#130] Mission Systems Confirguration
The arrangement of mission systems shall be approved based on the weight and center of gravity associated with each configuration
Mission-configuration properties shall specify the weight and center-of-gravity data associated with each approved mission-system configuration.
The configuration in which mission systems are installed shall be informed by how the arrangement affects vessel stability for each design loading condition.
Rationale: Mass properties like weight and center of gravity determine vessel displacement, weight distribution, and motion characteristics.

### 4.5 [#131] Loading Condition Coverage
The limiting loading states shall be identified in the intended operating envelope.
Rationale: Possible critical loading conditions must be defined in addition to the loaded conditions of routine operations.

## 5 [#132] Endurance
The vessel must sustain operations for the duration, range, and operational tempo required by its intended operational roles.
Rationale: Mission accomplishment depends on the continued availability of propulsion, electrical power, mission systems, and essential ship services throughout the intended operating profile. Insufficient endurance may restrict operational range, reduce mission persistence, interrupt the required operating tempo, or require premature replenishment or mission termination. Endurance must therefore be evaluated against defined operating conditions, consumable-resource availability, expected resource demand, and required operational reserves.

### 5.1 [#133] Fuel Storage Capacity
The onboard fuel storage capacity shall be at least equal to the sum of the operational fuel quantity and reserve fuel quantity for each fuel type carried.
Rationale: Onboard fuel storage establishes the fuel inventory available to fuel-consuming systems throughout vessel operations; the usable fuel inventory is determined by the intended operational profile and includes a contingency reserve.

#### 5.1.1 [#134] Usable Fuel Inventory
The usable inventory of each fuel type shall support at least 100 days of operation for all active consumers requiring that fuel type under the selected operating profile.
Rationale: Continuous vessel operation depends on the availability of usable fuel onboard, and the duration of an operational period is one factor that determines the minimum fuel inventory.

#### 5.1.2 [#135] Reserve Fuel Quantity
The onboard usable fuel inventory shall include reserve fuel quantities that collectively allow vessel operation for at least 1% of the intended operational duration.
Assumption: The reserve operating duration is provisionally set to 1% of the intended operational period under the assumptions that this reserve is sufficient and that this approach to determining the reserve needed is appropriate. This value shall be updated if an applicable MSC requirement or case-study-specific directive is identified. This approach to determining the quantity of fuel to be reserved also implicitly assumes that the rate of consumption under contingencies is the same as that provided for in the standard operating profile.
Rationale: The intended operational period may be extended or disrupted by delays, route deviations, adverse environmental conditions, equipment casualties, or other contingencies. A reserve operating duration equal to 1% of the intended operational duration provides limited continued vessel operation when actual fuel consumption exceeds the planned operational requirement.

#### 5.1.3 [#136] Fuel Type Allocation
For each onboard fuel type, the usable fuel quantity shall be greater than or equal to the operational fuel quantity plus a reserve equal to 1% of that operational fuel quantity.
Assumption: Fuel consumption rates and the relative distribution of demand among fuel types remain constant throughout the reserve operating period.
Rationale: Allocating fuel inventory by fuel type ensures that each fuel-consuming system has sufficient operational and reserve fuel to sustain its required function throughout the intended operational and reserve operating periods.

### 5.2 [#137] Fuel Delivery
Each active fuel consumer shall receive its required fuel type.
Rationale: Active consumers must receive their respective fuel types so they can convert chemical energy into the mechanical energy required for mechanical and electrical power generation.

#### 5.2.1 [#138] Fuel Delivery Rate
The aggregate rate of fuel delivery shall be greater than or equal to the aggregate rate of fuel demand of all active fuel consumers for the selected operating profile.
Assumption: This performance requirement assumes that comparing the aggregate rate of fuel delivery with the aggregate rate of fuel demand accurately represents the fuel delivery networks' ability to supply fuel at the rates needed for operation. This assumption does not represent cases in which the aggregate delivery rate meets the aggregate rate of demand because some rates of delivery are too high while others are too low with respect to fuel type, and these discrepancies cancel each other out when rates are summed.
NOTE: The current test_fuel.m script verifies only the aggregate fuel-rate balance. Full verification requires grouping fuel supply and demand by fuel type before performing the comparison.
Rationale: The fuel-delivery rate must meet or exceed the combined fuel demand of all active consumers to prevent interruption of vessel operations.

#### 5.2.2 [#139] Fuel Conditioning
Fuel shall flow through the conditioning subsystem appropriate for its fuel type and exit with the physical properties within the specified limits at the inlet of its assigned downstream fuel consumer.
Rationale: Fuel-consuming equipment depends on fuel entering at the temperature, pressure, and purification condition compatible with its combustion and fuel-handling requirements to prevent equipment degredation or interrupted fuel consumption.

#### 5.2.3 [#141] Fuel Routing
Fuel shall be routed from storage to its active consumers via the distribution network corresponding to its fuel type, conditioning needs, and delivery rates.
Rationale: Routing makes fuel delivery possible by giving fuel the directionality and impetus necessary for it to flow from source to sink.

#### 5.2.4 [#142] Consumer Fuel Supply
At each interface between the fuel delivery network and an active fuel consumer, fuel shall be delivered in a compatible form with the receiving consumer's operating parameters.
At each piping-to-consumer interface, the fuel supply system shall deliver fuel at the set pressure and temperature within the specified inlet operating limits of the receiving fuel-consuming equipment.
Rationale: For the consumer to accept and use the fuel supplied by the fuel delivery system, the fuel must have the physical properties that allow it to pass through the point of consumption without interruption.
NOTE: We have not yet defined what the acceptable fuel delivery conditions are for the fuel to be used by the active consumer.

## 6 [#150] Mobility and Maneuverability
The vessel must provide both precise and long-range control over vessel movement to facilitate strategic transit, port, bunkering, and mission operations within the intended operating environments.
Rationale: Different phases of operation—including long-distance transit, harbor maneuvering, bunkering, and mission execution—place different demands on vessel mobility and maneuverability. Providing both precise low-speed control and efficient long-range mobility enables the vessel to accomplish its operational objectives safely and effectively.

### 6.1 [#151] Longitudinal Motion Control

#### 6.1.1 [#152] Propulsive Force Generation
The propulsion train shall generate thrust in the ahead and astern directions.
Rationale: Propulsive force is required to overcome vessel resistance and produce controlled forward and backward motion.

#### 6.1.2 [#153] Propulsive Force Regulation
The propulsion train shall regulate longitudinal propulsive thrust to establish, maintain, and modify commanded longitudinal vessel speed.
Rationale: Controlled regulation of longitudinal propulsive thrust is required to enable predictable acceleration, deceleration, and steady-state operation of the vessel.

#### 6.1.3 [#160] Longitudinal Motion Arrest
Systems, including the propulsion train and anchoring system, shall reduce longitudinal velocity to zero by generating a resistive force opposite to thrust.
Rationale: Stopping capability is required to control the vessel's position in standard operating conditions and to prevent collision in emergency events.

##### 6.1.3.1 [#161] Absolute Stopping
Longitudinal velocity shall decelerate from [vi] to zero within [d] in [t].
Assumption: Conditions are assumed to be...

### 6.2 [#155] Maneuvering

#### 6.2.1 [#156] Course Keeping
The vessel shall regulate steering-induced yaw moment to counteract disturbing yaw moments and maintain a commanded course.
Rationale: To execute maneuvering functions, maintain directional stability, and navigate accurately, steering must prevent unintended yaw acceleration such that the vessel maintains its commanded course despite environmental and operational disturbances.

##### 6.2.1.1 [#162] Course Keeping Precision
The vessel shall be aligned with its commanded course within ±[X] degrees at [v].
Assumption: (describe the environmental and loading conditions this performance requirement applies to)

#### 6.2.2 [#157] Heading Change
The steering system shall generate and regulate the yaw moment that achieves the commanded change in heading.
Rationale: Maneuvers such as the execution of turns, change of course, and hazard avoidance necessitate the vessel's capability to change heading.

##### 6.2.2.1 [#163] Turning Response
The vessel shall complete a commanded heading change of [X] degrees within [Y] seconds without exceeding [Z] degrees of heading overshoot.
Assumption: (specify conditions)

##### 6.2.2.2 [#164] Tactical Diameter
The vessel shall maintain a tactical diameter less than or equal to [D] during a turning circle maneuver.
Assumption: (specify operating conditons)

##### 6.2.2.3 [#165] Advance
The vessel shall maintain an advance less than or equal to [A] during a turning circle maneuver.
Assumption: (specify conditions)

##### 6.2.2.4 [#166] Transfer
The vessel shall maintain a transfer less than or equal to [T] during a turning circle maneuver.
Assumption: (specify conditons)

#### 6.2.3 [#158] Turn Arrest
The steering system shall generate and regulate yaw moment to reduce vessel yaw rate to zero at the commanded heading.
Rationale: The capability to arrest turning motion is required to prevent overshoot and establish the commanded vessel heading following a heading-change maneuver.