% Requirement links of test_ExistComp_01.m (R2026a)

% lines 14-33 verifies ShipRequirements.slreqx#47
    % 1. LOCATE LINKED REQUIREMENT VIA HELPER
    linkedReq = fetchLinkedRequirement();
    testCase.verifyNotEmpty(linkedReq, ...
        'Verification Failed: Could not resolve a linked requirement for this test script.');

    % 2. READ & CLEAN CUSTOM ATTRIBUTE
    rawTarget = string(linkedReq.getAttribute('PerfVal1'));
    componentName = erase(strtrim(rawTarget), ["'", '"']); % Strips quotes and whitespace
    
    testCase.verifyNotEmpty(componentName, ...
        sprintf('Requirement ID "%s" Failed: "PerfVal1" custom attribute is empty.', linkedReq.Id));

    [~, cleanBlockName] = fileparts(componentName);

    % 3. SEARCH MODEL FOR ALL INSTANCES (Active + Inactive)
    foundAll = find_system(modelName, ...
        'MatchFilter', @Simulink.match.allVariants, ...
        'Name', cleanBlockName);

    if isempty(foundAll) && contains(componentName, '/')