% Requirement links of test_cAir.m (R2026a)

% lines 8-13 verifies ShipRequirements.slreqx#170
[airReq, ~] =sumPropIfOn('AirConsumed', 'AirConsumer', 'CompAirProfile');
[airGen, ~] =sumPropIfOn('AirProduced', 'AirProducer', 'CompAirProfile');


% 2. Use the test framework assertion
verifyGreaterThanOrEqual(testCase, airGen, airReq, ...