% Requirement links of test_cooling.m (R2026a)

% lines 8-13 verifies ShipRequirements.slreqx#11
[coolReq, ~] =sumPropIfOn('CoolConsumed', 'CoolConsumer', 'CoolingProfile');
[coolGen, ~] =sumPropIfOn('CoolProduced', 'CoolProducer', 'CoolingProfile');


% 2. Use the test framework assertion
verifyGreaterThanOrEqual(testCase, coolGen, coolReq, ...