% Requirement links of test_elec.m (R2026a)

% lines 8-13 verifies ShipRequirements.slreqx#4
[elecReq, ~] =sumPropIfOn('PowerRequired', 'ElectricalConsumer', 'ElectricalProfile');
[elecGen, ~] =sumPropIfOn('PowerGenerated', 'ElectricalGenerator', 'ElectricalProfile');


% 2. Use the test framework assertion
verifyGreaterThanOrEqual(testCase, elecGen, elecReq, ...