% Requirement links of test_fuel.m (R2026a)

% lines 8-13 verifies ShipRequirements.slreqx#13
    [fuelReq, ~] =sumPropIfOn('FuelRequired', 'FuelConsumer', 'FuelProfile');
    [fuelGen, ~] =sumPropIfOn('FuelProduced', 'FuelProducer', 'FuelProfile');
   

    % 2. Use the test framework assertion
    verifyGreaterThanOrEqual(testCase, fuelGen, fuelReq, ...