% Requirement links of test_lube.m (R2026a)

% lines 8-13 verifies ShipRequirements.slreqx#12
[lubeReq, ~] =sumPropIfOn('LubeRequired', 'LubeConsumer', 'LubeProfile');
[lubeGen, ~] =sumPropIfOn('LubeProduced', 'LubeProducer', 'LubeProfile');


% 2. Use the test framework assertion
verifyGreaterThanOrEqual(testCase, lubeGen, lubeReq, ...